# Grasshopper definition AutomaticFacadeBlocks.ghx (Grasshopper 1.0.8)
# plug-ins: Pufferfish

# ---- group: Input massing volumes
# Title: Automatic Facade Blocks  v1.1.1
# Meta: Author: Tom Dufficy
# Date: 2025-09-12
# Units: m
# License: MIT (see repo)
# 1. Input base geometry
# IO: Inputs
#   1. Base building masses
#   2. Choice of facade block
# 
# Outputs
# 3. Translated facade block onto massing
# 4. Previews of available blocks
# Notes: Description
# Applies chosen facade block to simple building massings. Intended to add facade options over time across definition versions
# 
# Notes
#   Intended for masterplans & context modelling for visualisations
# Works with flat volumes
# Currently assumes 3m floor-to-floor height, and will try to scale block modules to fill gaps (smaller modules work best - above 4m gets tricky)
# 
# Dependencies
# Rhino 8
# Changelog: v1.0
# Initial release
# 
# v1.1
# Added automatic scaling of modules to fill gaps
# 
# v1.1.1
# Added brep edges display
# Updated custom preview
# Added note about facade module widths
geo = Geometry([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])

# ---- group: Facade options / Facade 02
facade_block_02 = BlockInstance(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)

# ---- group: Facade options / Facade 05
facade_block_05 = BlockInstance(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)

# ---- group: Facade options / Facade 03
facade_block_03 = BlockInstance(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)

# ---- group: Facade options / Facade 04
facade_block_04 = BlockInstance(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)

# ---- group: Facade options / Facade 01
# 2. Choose a facade and connect width
facade_block_01 = BlockInstance(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)

# ---- group: Automatically adjust width
bbox = BoundingBox(Content=facade_block_01, Plane=PlaneXY(0, 0, 0))  # -> Box, Box_2
debox = DeconstructBox(Box=bbox.Box)  # -> Plane, X, Y, Z
roundd = RoundToDecimalPlace(NumberX=debox.X, DecimalPlace=2, RoundType=0)  # -> Rounded, Difference

# ---- group: Find top & bottom surfaces of volumes, split curves into sides
debrep = DeconstructBrep(Brep=geo)  # -> Faces, Edges, Vertices
edges = BrepEdges(Brep=geo)  # -> Naked, Interior, NonManifold
area = Area(Geometry=debrep.Faces)  # -> Area, Centroid
pdecon = Deconstruct(Point=area.Centroid)  # -> XComponent, YComponent, ZComponent
sort = SortList(Keys=pdecon.ZComponent, ValuesA=debrep.Faces)  # -> Keys, ValuesA
rev = ReverseList(List=sort.ValuesA)
item = ListItem(List=sort.ValuesA, Index=0, Wrap=True)
item_2 = ListItem(List=rev, Index=0, Wrap=True)
crv = Curve(item)
explode = Explode(Curve=crv, Recursive=True)  # -> Segments, Vertices

# ---- group: Finding remainder after dividing by distance, distributing across modules, calculating scale factor for facades
num = Number(roundd.Rounded)
crv_2 = Curve(explode.Segments)
panel = Panel(num)
divlength = DivideLength(Curve=crv_2, Length=num)  # -> Points, Tangents, Parameters
len = Length(Curve=crv_2)
division = Division(A=len, B=num)
expression = Expression(x=division, Expression="floor(x)")
lng = ListLength(List=divlength.Points)  # -> expr("x-1", Length)
multiplication = Multiplication(A=expression, B=num)
trim = TrimTree(Tree=lng, Depth=1)
subtraction = Subtraction(A=len, B=multiplication)
division_2 = Division(A=subtraction, B=trim)
addition = Addition(A=division_2, B=num)
divlength_2 = DivideLength(Curve=crv_2, Length=addition)  # -> Points, Tangents, Parameters
division_3 = Division(A=addition, B=num)

# ---- group: Distribute frames and modules along curves and resize
pframe = PerpFrame(Curve=graft(explode.Segments), Parameter=divlength_2.Parameters)
lastdex = LastIndex(List=pframe)
yz = YZPlane(Origin=Point(0, 0, 0))
cull_i = CullIndex(List=pframe, Indices=lastdex, Wrap=True)
orient = Orient(Geometry=facade_block_01, Source=yz, Target=cull_i)  # -> Geometry, Transform
graft = GraftTree(Tree=division_3, IncludeEmptyLists=True, IncludeNullItems=True)
scale_nu = ScaleNU(Geometry=orient.Geometry, Plane=cull_i, ScaleX=1, ScaleY=1, ScaleZ=graft)  # -> Geometry, Transform

# ---- group: Block examples
block_instance = BlockInstance([facade_block_01, facade_block_02, facade_block_03, facade_block_04, facade_block_05])
lng_2 = ListLength(List=block_instance)
# 4. Block previews
series = Series(Start=0, Step="5", Count=lng_2)
Y = UnitY(Factor=series)
move = Move(Geometry=block_instance, Motion=Y)  # -> Geometry, Transform
block_instance_2 = BlockInstance(move.Geometry)
preview = CustomPreview(Geometry=block_instance_2, Material=ColourSwatch(SwatchColor=RGB(220, 118, 139)))

# ----
# 3. Bake blocks, bake top surfaces (optional)
block_instances = BlockInstance(scale_nu.Geometry)
top_surfaces = Geometry(item_2)

# ---- group: Custom visual display
swatch = ColourSwatch(SwatchColor=RGB(206, 172, 139))
preview_2 = CustomPreview(Geometry=top_surfaces, Material=swatch)
preview_3 = CustomPreview(Geometry=block_instances, Material=swatch)
